# Grasshopper definition Speckle Grasshopper - Documentation.gh (Grasshopper 1.0.8)
# plug-ins: Speckle.Connector.Grasshopper

# ---- group: Objects - 1 : Speckle Data Object
# OBJECTS
# Speckle Objects can be:
# 1. Data Objects. Used to represent groups of geometry for BIM, civil, and structural objects from Revit, Archicad, Navis, Civil 3D, Etabs, Tekla, and more.
# 2. Geometry. Used for geometry workflows between Rhino, GH, AutoCAD, and SketchUp
# See the `Speckle Geometry Param` and `Speckle Data Object Param` for more information on behavior in Grasshopper.
# Use the `Speckle Data Object` passthrough node to create or mutate Speckle data objects
# 
# 1. Add an optional Speckle Data Object if you want to inspect or mutate an existing object
# 2. Add an optional `Geometries` input. Will mutate the input Speckle Data Object, or create a new one.
# 3. Add an optional `Name` input. Will mutate the Speckle Data Object.
# 4. Add an optional `Properties` input. Will mutate the Speckle Data Object.
# 
# Colors and materials should be set on the input geometries individually.
speckle_data_object = SpeckleDataObject()
geometry = Geometry()
speckle_properties = SpeckleProperties()
speckle_data_object_2 = SpeckleDataObject(SpeckleDataObject=speckle_data_object, Geometries=geometry, Properties=speckle_properties)  # -> SpeckleDataObject, Geometries, Name, Properties, Path

# ---- group: Collections - 1 : Collection Selector
# COLLECTIONS
# Speckle Collections are containers for Speckle Objects. All Speckle Models are structured by Collections, which can represent Layers, Categories, Levels, etc in the source application.
# Speckle Models are Collections themselves. See the `Speckle Collection param` for more information on behavior in Grasshopper.
# Use the `Collection Selector` input node to view all of the sub-Collection paths inside the input Collection.
# 
# 1. Add the required input Collection parameter. This can be the output of the Load nodes.
# 2. You will see all the Collections inside your input Collection by their path (similar to Rhino Layers)
# 3. Left-click to select a Collection path, or shift+left-click to select multiple.
# 4. Double click the `Search` field at the top to filter paths that match the search. Supports regex.
# 
# This node is used as an optional input for the `Query Objects` node
speckle_collection = SpeckleCollection()
collection_selector = CollectionSelector(speckle_collection)

# ---- group: Parameters - 1 : Speckle Collection
# PARAMETERS
# These parameters represent Speckle entities, and are interoperable with native Rhino and Grasshopper entities. Some also contain bake capabilities.
# Speckle Collection Param represents Layers in the Rhino context.
# 
# CASTING:
# - Castable to and from Grasshopper 8 Model Layers.
#   Preserves Name, Color, and Material.
# 
# BAKE:
# - Will create a Layer in the Rhino Document.
#   Uses the full path, Name, Color, and Material of the Collection.
# 
# PREVIEW:
# - Will preview all contained Objects inside the Collection.
speckle_collection_2 = SpeckleCollection()

# ---- group: Dev - 1 : Deconstruct
# DEV
# Dev components give you additional features, for advanced Speckle and Grasshopper users.
# Use the `Deconstruct` node to inspect all fields inside a Speckle Param.
# 
# 1. Add a Speckle Object, Speckle Material, Speckle Properties, or Speckle Collection input.
# 2. An output will be generated for every field of the Speckle param.
# 
# This component exposes fields on any Base-derived Speckle entity that isn't convertible to native Rhino/GH.
speckle_collection_3 = SpeckleCollection()
speckle_data_object_3 = SpeckleDataObject()
speckle_material = SpeckleMaterial()
speckle_properties_2 = SpeckleProperties()
speckle_geometry = SpeckleGeometry()
deconstruct = Deconstruct(SpeckleParam=[speckle_collection_3, speckle_data_object_3, speckle_geometry, speckle_material, speckle_properties_2])

# ---- group: Operations - 1 : Speckle Model Link
# Speckle for Grasshopper
# Welcome to the Speckle Next-Gen Grasshopper connector!
# Use this sample file for documentation on each Speckle node.
# 
# Full Speckle Grasshopper documentation is available at:
# 
# docs.speckle.systems/connectors/grasshopper/grasshopper
# 
# Speckle for Grasshopper and docs is built and maintained by claire@speckle.systems.
# Reach out on speckle.community for feedback, bug reports, and requests.
# Documentation
# OPERATIONS
# Speckle operations allow you to publish your Grasshopper model to Speckle, or load any model into Grasshopper.
# https://app.speckle.systems/projects/8be1007be1/models/13a2953168
# Use the `Speckle Model` input node for all of your account, workspace, and model management.
# 
# 1. Right click node to change Account
# 2. Left click first button to change workspace
# 3. Left click `Select Project` button to select your project
# 3. Left click `Select Model` button to select your model
# 4. By default, the version will be the latest version. Left click node `Version` to select a specific version.
# 
# Alternatively, pipe in a text url copied from your model on the Speckle web app.
# The Project, Model, and Version information will be populated for you automatically.
speckle_model = SpeckleModel(Server="https://app.speckle.systems", User="B8C2972E1A6094F9A8CCA818CE15D06F", Workspace="cf09b9fc90")

# ----
# Speckle Data Object Param represents a group of geometries in the Rhino context.
# 
# CASTING:
# - Castable to and from a single Grasshopper 8 Model Object.
#   Preserves Name, User Strings, Color, and Material.
# - Castable to and from a single Geometry
# 
# BAKE:
# - Will create a group of Geometry objects in the Rhino Document in its Layer.
#   Bakes with shared Name and User Strings, and any Color / Material.
#   Layers for the Collection path will be created if they do not exist.
#   Material for the Geometries will be created if it does not exist.
# 
# PREVIEW:
# - Will preview any geometry contained inside the Speckle Data Object
speckle_data_object_4 = SpeckleDataObject()

# ---- group: Objects - 2 : Speckle Geometry
# Use the `Speckle Geometry` passthrough node to create or mutate Speckle Geometry.
# 
# 1. Add an optional Speckle Geometry if you want to inspect or mutate an existing geometry.
# 2. Add an optional `Geometry` input. Will mutate the input Speckle Geometry, or create a new Geometry.
# 3. Add an optional `Name` input. Will mutate the Speckle Geometry.
# 4. Add an optional `Properties` input. Will mutate the Speckle Geometry.
# 5. Add an optional `Color` input. Will *NOT* mutate the Speckle Geometry.
# 6. Add an optional `Material` input. Will *NOT* mutate the Speckle Geometry.
colour_swatch = ColourSwatch(SwatchColor=RGB(255, 255, 255))
speckle_object = SpeckleObject()
geometry_2 = Geometry()
speckle_properties_3 = SpeckleProperties()
speckle_material_2 = SpeckleMaterial()
speckle_geometry_2 = SpeckleGeometry(
    SpeckleGeometry=speckle_object,
    Geometry=geometry_2,
    Properties=speckle_properties_3,
    Color=colour_swatch,
    Material=speckle_material_2)  # -> SpeckleGeometry, Geometry, Name, Properties, Color, Material, Path

# ---- group: Dev - 2 : (Sync) Load
# Use the `(Sync) Load` node to load your Speckle model into Grasshopper.
# 
# 1. Add the required Model Link input from the `Speckle Model Url` node
# 2. Connect a boolean toggle and set to `True`
# 3. Your Speckle model will now load synchronously. Larger models will take longer to load.
# 4. Your loaded model is a Speckle Collection object, previewed by this node.
# 
# *This node will run synchronously.*
# As soon as you toggle `Run` to `True`, your Grasshopper script will freeze until the load is complete.
# Use this node if you are running in an environment that does not support async operations.
boolean_toggle = BooleanToggle(False)
sync_load = SyncLoad(Run=boolean_toggle)

# ---- group: Collections - 2 : Expand Collection
# Use the `Expand Collection` node to get the direct children of the input Collection.
# Direct children can be either other Collections, or Speckle Objects.
# 
# 1. Add the required input Collection parameter. This can be the output of the Load nodes.
# 2. An output parameter will be generated for every sub-collection inside the input Collection.
# 3. A single output will be generated for all Speckle Objects directly inside the input Collection.
# 
# This node can be chained consequtively to retrieve the direct children of any output Collections.
# This is an alternative to the "Collection Selector + Query Objects" nodes.
speckle_collection_4 = SpeckleCollection()
expand_collection = ExpandCollection(Collection=speckle_collection_4)

# ---- group: Operations - 2 : Load
# Use the `Load` node to load your Speckle model into Grasshopper.
# 
# 1. Add the required Model Link input from the Speckle Model Link node (Operations - 1)
# 2. Press the `Load` button
# 3. Right-click node and select `Cancel` to cancel an ongoing Load operation.
# 4. Your loaded Speckle model is a Speckle Collection object, previewed by this node.
# 
# This node will run async: you can continue to use Grasshopper while your model is loading.
# Right click to enable automatic loading of new versions of your model.
# This option is available as long as you do not specify a specific version to load in your Model Link input.
load = Load()

# ---- group: Parameters - 3 : Speckle Geometry
# Speckle Geometry Param represents geometries in the Rhino context.
# 
# CASTING:
# - Castable to and from Grasshopper 8 Model Objects.
#   Preserves Name, User Strings, Color, and Material.
# - Castable to and from Geometry
# 
# BAKE:
# - Will create a Geometry object in the Rhino Document in its Layer.
#   Bakes with Name, User Strings, Color, and Material.
#   Layers for the Collection path will be created if they do not exist.
#   Material for the geometry will be created if it does not exist.
# 
# PREVIEW:
# - Will preview any geometry contained in the Speckle Geometry.
speckle_geometry_3 = SpeckleGeometry()

# ---- group: Collections - 3 : Create Collection
# Use `Create Collection` node to create Speckle Collections to structure your Speckle Model.
# 
# 1. This node has variable inputs. Each input will create a sub Collection in the output Collection.
# 2. Right-click any input to change the name of the sub-Collection
# 3. Pipe in Speckle Objects or Speckle Collections into the input. Inputs cannot contain both.
# 4. Remove any empty collections that you don't want
# 
# Tips: Press `TAB` while adding an input to inherit the input nickname.
# Or right-click the node and select `Always Inherit Names` to turn this setting on for all inputs.
# 
# This node is primarily used to create the Speckle Model for publishing to Speckle.
speckle_object_2 = SpeckleObject()
speckle_collection_5 = SpeckleCollection()
create_collection = CreateCollection(SubCollection1=speckle_collection_5, SubCollection2=speckle_object_2, AlwaysInheritNames=False)

# ---- group: Objects - 3 : Filter Objects
# Use the `Filter Objects` node to filter Speckle Objects that match search requirements.
# 
# 1. Add the list of Objects to filter.
# 2. Add an optional `Name` input. Only objects with matching names will remain.
# 3. Add an optional `Property Key` input. Only objects with a matching property will remain.
# 4. Add an optional `Material Name` input. Only objects with matching materials will remain.
# 5. Add an optional `Application Id` input. Only objects with matching applicationId will remain.
# 6. Add an optional `Speckle Id` input. Only objects with matching id will remain.
# 
# Mouseover the input parameters to see match options, including regex searching.
# All objects that don't match the filter requirements will be output in Culled Objects
speckle_object_3 = SpeckleObject()
filter_objects = FilterObjects(Objects=speckle_object_3)  # -> Objects, CulledObjects

# ---- group: Dev - 3 : (Sync) Publish
# Use the `(Sync) Publish` node to publish your GH model to Speckle.
# 
# 1. Add the required Model Link input from the `Speckle Model Url` node
# 2. Add the Speckle model you want to publish
# 2. Connect a boolean toggle and set to `True`
# 3. Your Speckle model will now publish synchronously. Larger models will take longer to publish
# 4. Right-click `View online` to open your published model in your default web browser.
# 
# *This node will run synchronously.*
# As soon as you toggle `Run` to `True`, your GH script will freeze until the publish is complete.
# Use this node if you are running in an environment that does not support async operations.
boolean_toggle_2 = BooleanToggle(False)
speckle_collection_6 = SpeckleCollection()
sync_publish = SyncPublish(Collection=speckle_collection_6, Run=boolean_toggle_2)

# ---- group: Operations - 3 : Publish
# Use the `Publish` node to publish your Grasshopper Speckle model to your Speckle Project.
# 
# 1. Add the required Model Url input from the `Speckle Model Url` node (Operations - 1)
# 2. Add the Speckle model Collection
# 2. Press the `Publish` button
# 3. Right-click node and select `Cancel` to cancel an ongoing Publish operation.
# 4. Right-click node and select `View online` to open your published model in your default browser.
# 
# This node will run async: you can continue to use Grasshopper while your model is publishing
# Right-click to enable automatic publishing whenever this node recomputes.
speckle_collection_7 = SpeckleCollection()
publish = Publish(Collection=speckle_collection_7)

# ---- group: Parameters - 3 : Speckle Properties
# Speckle Properties Param represents user strings in the Rhino context.
# 
# CASTING:
# - Castable from Grasshopper 8 Model Objects.
#   Lets you use the User Text node to create Properties with keyvalues.
# - Castable to and from Dictionary<string, object?>
# 
# BAKE:
# - None
# 
# PREVIEW:
# - None
speckle_properties_4 = SpeckleProperties()

# ---- group: Objects - 4 : Query Objects
# Use the `Query Objects` node to retrieve Speckle Objects inside the input Collection.
# 
# 1. Add the required input Collection parameter. This can be the output of the Load nodes.
# 2. By default, all contained Speckle Objects in a flat list (including those in sub Collections).
# 3. If paths are input, the direct Speckle Object children of the path are output in a branch per path.
speckle_collection_8 = SpeckleCollection()
query_speckle_objects = QuerySpeckleObjects(Collection=speckle_collection_8)

# ---- group: Operations - 4: Sign In
# Use the `Sign-In` node to sign in to your Speckle account.
# 
# 1. Input the URL of the server you would like to sign in to.
# 2. Click `Sign-In`
# 3. Complete steps in your web browser
# 4. After you sign-in once, your account will be stored on your computer locally.
# You only need to sign in to the same account once across all your Speckle connectors.
# 
# This node can be delete from your script after sign-in.
sign_in = SignIn()

# ---- group: Dev - 4 : Speckle Model URL
# Use the `Speckle Model Url` input node to authenticate with developer token instead of user input.
# 
# 1. Add the input Speckle model url
# 2. Add your developer token
speckle_model_url = SpeckleModelURL()

# ---- group: Parameters - 4 : Speckle Material
# Speckle Material Param represents materials in the Rhino/GH context.
# 
# CASTING:
# - Castable to and from GH8 Model Materials.
# - Castable to and from GH8 Render Materials.
# - Castable to and from Display Materials.
# 
# BAKE:
# - Will create a Material in the Rhino Doc with the name of Speckle Material.
#   The Nickname of the param is used when no name exists.
# 
# PREVIEW:
# - None
speckle_material_3 = SpeckleMaterial()

# ---- group: Objects - 5 : Speckle Properties
# Use the `Speckle Properties` passthrough node to create or modify properties by keyvalues.
# 
# 1. Add the optional input Properties parameter to modify an existing set of properties.
# 2. Add the optional set of keys to use.
# 3. Add the optional set of values to use
# 
# Right-click and change the mode if needed.
# By default, mode is set to `Merge` input keys and values to the input set.
speckle_properties_5 = SpeckleProperties()
speckle_properties_6 = SpeckleProperties(Properties=speckle_properties_5, Mode="Merge")  # -> Properties, Keys, Values

# ---- group: Objects - 6 : Property Selector
# Use the `Property Selector` input node to view all of the properties inside an Object.
# 
# 1. Add the required input Properties parameter.
# 2. You will see all the Property keys inside your input Properties, including nested properties.
# 3. Left-click to select a Property key, or shift+left-click to select multiple.
# 4. Double click the `Search` field at the top to filter keys that match the search. Supports regex.
# 
# This node is used as an input for the `Query Properties` node
speckle_properties_7 = SpeckleProperties()
property_selector = PropertySelector(speckle_properties_7)

# ---- group: Objects - 7: Query Properties
# Use the `Query Properties` node to retrieve the values of properties by their keys.
# 
# 1. Add the required input Properties parameter.
# 2. Add the required input Keys parameter, for example from the Property Selector node.
# 3. An output is generated for every input key, with the value of that key in its own branch.
speckle_properties_8 = SpeckleProperties()
query_properties = QueryProperties(Properties=speckle_properties_8)

# ----
speckle_properties_9 = SpeckleProperties()

# ---- group: Objects - 8: Create Properties
# Use `Create Properties` node to create Speckle Properties to add metadata to your Objects.
# 
# 1. This node has variable inputs. Each input will create a Property in the output Properties.
# 2. Right-click any input to change the key of the property
# 3. Inputs can contain:
# - simple types like strings, bools, numbers, planes, and vectors
# - other speckle properties (will nest)
# - right-click and select `list access` to set the access type to list
# 
# Tips: Press `TAB` while adding an input to inherit the input nickname.
# Or right-click the node and select `Always Inherit Names` to turn this setting on for all inputs.
# 
# The output of this node is used for the `Speckle Geometry` or `Speckle Data Object` node.
number = Number()
text = Text()
boolean = Boolean()
create_properties = CreateProperties(
    Property1=number,
    Property2=text,
    Property3=boolean,
    Property4=speckle_properties_9,
    AlwaysInheritNames=False,
    CreateEmptyProperties=False)
